# Grasshopper definition iDraw_control.gh (Grasshopper 1.0.7)
# plug-ins: iDraw_GH

# ---- group: Machine space rectangle, A1
rectangle = Rectangle({Plane=PlaneXY(297, -420.5, 0), Size=Domain2(u=-297..297, v=-420.5..420.5)})

# ---- group: Paper size
rectangle_2 = Rectangle({Plane=PlaneXY(241.5, -305, 0), Size=Domain2(u=-241.5..241.5, v=-305..305)})

# ----
offset_curve = OffsetCurve(Curve=rectangle_2, Distance=-20, Corners=1)

# ---- group: CONTROLS
randomize_closed_curve_seams = BooleanToggle(False)
sample_spacing = Slider(0.25, range=0.25..10)
reorder_curves = BooleanToggle(True)
travel_speed = ValueList({"1000", "2000", "3000", "4000", "5000", "6000", "7000", "8000", "9000", "10000"}, selected="8000")
draw_speed = ValueList({"1000", "2000", "3000", "4000", "5000", "6000", "7000", "8000", "9000", "10000"}, selected="6000")

# ---- group: Original curves
curve = Curve([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])

# ----
stream_gate = StreamGate(Stream=curve, Gate=randomize_closed_curve_seams)  # -> Target0, Target1

# ---- group: randomize closed curve seams
curve_2 = Curve(stream_gate.Target1)
closed = Closed(Curve=curve_2)  # -> Closed, Periodic
dispatch = Dispatch(List=curve_2, DispatchPattern=closed.Closed)  # -> ListA, ListB
list_length = ListLength(List=dispatch.ListA)
random = Random(Range=Domain(0, 1), Number=list_length, Seed=Slider(123456, range=0..1000000))
seam = Seam(Curve=reparameterize(dispatch.ListA), Seam=random)
weave = Weave(Pattern=closed.Closed, Stream0=dispatch.ListB, Stream1=seam, NullGaps=False)

# ----
stream_filter = StreamFilter(Gate=randomize_closed_curve_seams, Stream0=stream_gate.Target0, Stream1=weave)
stream_gate_2 = StreamGate(Stream=stream_filter, Gate=reorder_curves)  # -> Target0, Target1

# ---- group: Reorder curves using KD Tree CFT
# Some basic sorting so we dont have a lot of wasteful travel moves
c_script = CSharpScript(curves=stream_gate_2.Target1)  # -> out, A; inputs curves: list of Curve
# ---------- c_script: C# ----------
    // Check input
    if (curves == null || curves.Count == 0)
    {
      A = "No curves provided!";
      return;
    }

    // Step 1: Build spatial partitioning for curve start points
    List<Point3d> startPoints = new List<Point3d>();
    for (int i = 0; i < curves.Count; i++)
    {
      if (curves[i] != null && curves[i].IsValid)
        startPoints.Add(curves[i].PointAtStart);
    }

    // Simple KDTree for spatial partitioning
    KDTree<int> kdTree = new KDTree<int>();
    for (int i = 0; i < startPoints.Count; i++)
    {
      kdTree.Insert(startPoints[i], i);
    }

    // Step 2: Reorder curves based on minimal travel distance
    List<Curve> orderedCurves = new List<Curve>();
    HashSet<int> visited = new HashSet<int>();

    // Start with the first curve
    Curve currentCurve = curves[0];
    orderedCurves.Add(currentCurve);
    visited.Add(0);

    for (int i = 1; i < curves.Count; i++)
    {
      Point3d endPoint = currentCurve.PointAtEnd;

      // Find the nearest unvisited start point
      int nearestIndex = kdTree.Nearest(endPoint, ptIndex => !visited.Contains(ptIndex));
      if (nearestIndex == -1)
      {
        A = "Error during reordering!";
        return;
      }

      // Add the nearest curve to the order
      orderedCurves.Add(curves[nearestIndex]);
      visited.Add(nearestIndex);

      // Update the current curve
      currentCurve = curves[nearestIndex];
    }

    // Output the reordered curves
    A = orderedCurves;
# ---------- c_script: C# additional code ----------
  // KDTree class for spatial partitioning
  public class KDTree<T>
  {
    private class Node
    {
      public Point3d Point;
      public T Data;
      public Node Left, Right;
    }

    private Node root;

    public void Insert(Point3d point, T data)
    {
      root = Insert(root, point, data, 0);
    }

    public T Nearest(Point3d target, Func<T, bool> condition)
    {
      return Nearest(root, target, condition, 0).Item2;
    }

    private Node Insert(Node node, Point3d point, T data, int depth)
    {
      if (node == null)
        return new Node { Point = point, Data = data };

      int axis = depth % 3;
      if ((axis == 0 && point.X < node.Point.X) ||
        (axis == 1 && point.Y < node.Point.Y) ||
        (axis == 2 && point.Z < node.Point.Z))
        node.Left = Insert(node.Left, point, data, depth + 1);
      else
        node.Right = Insert(node.Right, point, data, depth + 1);

      return node;
    }

    private Tuple<double, T> Nearest(Node node, Point3d target, Func<T, bool> condition, int depth)
    {
      if (node == null) return new Tuple<double, T>(double.MaxValue, default(T));

      int axis = depth % 3;
      double distance = node.Point.DistanceTo(target);
      T result = default(T);

      if (condition(node.Data))
        result = node.Data;

      Node nextBranch = (axis == 0 && target.X < node.Point.X) ||
        (axis == 1 && target.Y < node.Point.Y) ||
        (axis == 2 && target.Z < node.Point.Z)
        ? node.Left : node.Right;
      Node otherBranch = nextBranch == node.Left ? node.Right : node.Left;

      var best = Nearest(nextBranch, target, condition, depth + 1);
      if (distance < best.Item1 && condition(result))
        best = new Tuple<double, T>(distance, result);

      if (Math.Abs((axis == 0 ? target.X - node.Point.X :
        axis == 1 ? target.Y - node.Point.Y :
        target.Z - node.Point.Z)) < best.Item1)
      {
        var otherBest = Nearest(otherBranch, target, condition, depth + 1);
        if (otherBest.Item1 < best.Item1)
          best = otherBest;
      }

      return best;
    }
  }
# ---------- end c_script ----------

# ----
stream_filter_2 = StreamFilter(Gate=reorder_curves, Stream0=stream_gate_2.Target0, Stream1=c_script.A)

# ---- group: This is a little slow
# this is some code i had chatgpt cook up and its not the fastest
# 
# it takes in a list of curves and a target sample spacing number
# 
# if a curve is a line, it just gets the end points.
# if a curve is a polyline, it just gets the points.
# if a curve is smooth it samples it near target spacing.
# if a curve is a polycurve it treats each segment as described above.
c_script_2 = CSharpScript(curve=stream_filter_2, target=sample_spacing)  # -> out, simplify(A); inputs curve: Curve, target: Double
# ---------- c_script_2: C# ----------
    Component.Message = "Plotter Divide";
    A = DivideCurve(curve, target);
# ---------- c_script_2: C# additional code ----------
  // Recursive function to divide curves and return points
  private List<Point3d> DivideCurve(Curve curve, double targetSpacing)
  {
    List<Point3d> points = new List<Point3d>();

    if (curve == null || !curve.IsValid)
      return points;

    // Case 1: Line Curve
    if (curve.IsLinear(Rhino.RhinoDoc.ActiveDoc.ModelAbsoluteTolerance))
    {
      points.Add(curve.PointAtStart);
      points.Add(curve.PointAtEnd);
      return points;
    }

    // Case 2: Polyline Curve
    Polyline polyline;
    if (curve.TryGetPolyline(out polyline))
    {
      points.AddRange(polyline);
      return points;
    }

    // Case 3: PolyCurve
    if (curve is Rhino.Geometry.PolyCurve)
    {
      PolyCurve polycurve = (PolyCurve) curve; // Explicit cast
      polycurve.RemoveNesting(); // Ensure no nested polycurves

      Curve[] segments = polycurve.Explode();
      if (segments == null || segments.Length == 0)
      {
        RhinoApp.WriteLine("PolyCurve.Explode() returned no segments.");
        return points;
      }

      // Process each segment
      for (int i = 0; i < segments.Length; i++)
      {
        if (segments[i] == null || !segments[i].IsValid)
          continue;

        // Handle linear subsegments directly
        if (segments[i].IsLinear(Rhino.RhinoDoc.ActiveDoc.ModelAbsoluteTolerance))
        {
          if (i == 0)
          {
            // First segment: Add both start and end points
            points.Add(segments[i].PointAtStart);
            points.Add(segments[i].PointAtEnd);
          }
          else
          {
            // Subsequent segments: Add only the end point
            points.Add(segments[i].PointAtEnd);
          }
        }
        else
        {
          // Recursively handle non-linear segments
          List<Point3d> segmentPoints = DivideCurve(segments[i], targetSpacing);

          if (segmentPoints.Count > 0)
          {
            if (i == 0)
            {
              // First segment: Add all points
              points.AddRange(segmentPoints);
            }
            else
            {
              // Subsequent segments: Add all except the first point
              for (int j = 1; j < segmentPoints.Count; j++) // Start from index 1
              {
                points.Add(segmentPoints[j]);
              }
            }
          }
        }
      }

      return points;
    }

    // Case 4: Smooth NURBS or other curves
    points.AddRange(TargetDivide(curve, targetSpacing));
    return points;
  }




  //-----------------------------------------------------------------------------------------------------------

  //function to divide a curve with target spacing between points
  private List<Point3d> TargetDivide(Curve curve, double targetSpacing)
  {
    List<Point3d> points = new List<Point3d>();

    if (curve == null || !curve.IsValid || targetSpacing <= 0)
      return points;

    double len = curve.GetLength();
    int numSegments = (int) Math.Ceiling(len / targetSpacing);

    Point3d[] segmentPoints;
    curve.DivideByCount(numSegments, true, out segmentPoints);

    if (segmentPoints != null)
      points.AddRange(segmentPoints);

    // Ensure closure for closed curves
    if (curve.IsClosed && points.Count > 0 && !points[0].DistanceTo(points[points.Count - 1]).Equals(0))
    {
      points.Add(points[0]); // Explicitly close the curve
    }

    return points;
  }
# ---------- end c_script_2 ----------

# ----
deconstruct = Deconstruct(Point=c_script_2.A)  # -> XComponent, YComponent, ZComponent

# ---- group: create different speeds per point per toolpath
list_length_2 = ListLength(List=deconstruct.YComponent)  # disabled
range = Range(Domain=Domain(0, 1), Steps=expr("x-1", list_length_2))  # disabled
graph_mapper = GraphMapper(range, x0=0, x1=1, y0=0, y1=1, container_name="Bezier", cpx=[0, 0.6967893839, 0.2986166775, 1], cpy=[0, 1, 0, 0])  # disabled
bounds = Bounds(Numbers=graph_mapper)  # disabled
remap_numbers = RemapNumbers(Value=graph_mapper, Source=bounds, Target=Domain(500, 8000))  # -> Mapped, Clipped; disabled
expression = Expression(x=remap_numbers.Mapped, Expression="Round(x,2)")  # disabled

# ---- group: visualize travel moves
polyline = PolyLine(Vertices=c_script_2.A, Closed=False)
end_points = EndPoints(Curve=flatten(polyline))  # -> Start, End
shift_list = ShiftList(List=end_points.Start, Shift=1, Wrap=False)
custom_preview = CustomPreview(Geometry=polyline, Material=ColourSwatch(SwatchColor=RGB(0, 0, 0)))
line = Line(StartPoint=end_points.End, EndPoint=shift_list)
cull_index = CullIndex(List=line, Indices=-1, Wrap=True)
list_length_3 = ListLength(List=cull_index)
series = Series(Start=0, Step=1, Count=list_length_3)
gradient = Gradient(
    LowerLimit=0,
    UpperLimit=expr("x-1", list_length_3),
    Parameter=series,
    stops=[0: RGB(255, 0, 0), 0.103: RGB(255, 140, 0), 0.199: RGB(229, 255, 0), 0.3: RGB(85, 255, 0), 0.398: RGB(0, 255, 64), 0.497: RGB(0, 255, 217), 0.6: RGB(0, 153, 255), 0.702: RGB(0, 8, 255), 0.796: RGB(132, 0, 255), 0.897: RGB(255, 0, 234), 1: RGB(255, 0, 89)])
custom_preview_2 = CustomPreview(Geometry=cull_index, Material=gradient)

# ---- group: round coordinates to 2 decimal places
expression_2 = Expression(x=deconstruct.XComponent, Expression="Round(x,2)")
expression_3 = Expression(x=deconstruct.YComponent, Expression="Round(x,2)")

# ----
concatenate = Concatenate(Fragment_A="G1X", Fragment_B=expression_2, space="Y", B=expression_3, f="F", C=draw_speed)

# ---- group: visualize travel moves
length = Length(Curve=flatten(polyline))
length_2 = Length(Curve=flatten(line))
mass_addition = MassAddition(Input=length)  # -> Result, PartialResults
mass_addition_2 = MassAddition(Input=length_2)  # -> Result, PartialResults
integer = Integer(mass_addition.Result)
integer_2 = Integer(mass_addition_2.Result)
addition = Addition(A=integer_2, B=integer)
pen_up_travel_length_mm = Panel(integer_2)
pen_down_travel_length_mm = Panel(integer)
total_travel_length_mm = Panel(addition)

# ---- group: set travel moves to travel speed
list_item = ListItem(List=concatenate, Index=0, Wrap=True)
c_script_3 = CSharpScript(str=list_item, trvSpeed=travel_speed)  # -> out, A; inputs str: String, trvSpeed: Double
# ---------- c_script_3: C# usings ----------
using System.Text.RegularExpressions;
# ---------- c_script_3: C# ----------
    A = Regex.Replace(str, @"(?<=F)\d+(\.\d+)?", trvSpeed.ToString());
# ---------- end c_script_3 ----------
replace_items = ReplaceItems(List=concatenate, Item=c_script_3.A, Indices=0, Wrap=False)  # -> simplify(List)

# ---- group: add pen down / up movements at start / end of every curve
pen_down = Panel("G1Z7F2000")
pen_up = Panel("G1Z0F2000")
insert_items = InsertItems(List=replace_items, Item=pen_down, Indices=1, Wrap=True)  # -> simplify(List)
insert_items_2 = InsertItems(List=insert_items, Item=pen_up, Indices=-1, Wrap=True)  # -> simplify(flatten(List))

# ---- group: add beginning and ending gcode
home_abs_positioning_set_origin = Panel("""$H
G90
G17
G92X0Y0Z0""")
pen_up_home_sleep = Panel("""G1Z0F2000
$H
$SLP""")
insert_items_3 = InsertItems(List=insert_items_2, Item=home_abs_positioning_set_origin, Indices=0, Wrap=True)
insert_items_4 = InsertItems(List=insert_items_3, Item=pen_up_home_sleep, Indices=-1, Wrap=True)

# ---- group: FINAL GCODE PREVIEW
construct_domain = ConstructDomain(DomainStart=0, DomainEnd=1000)
sub_list = SubList(List=insert_items_4, Domain=construct_domain, Wrap=True)  # -> List, Index
panel = Panel(sub_list.List)

# ---- group: RUN IT
file_path = FilePath("D:\iDraw\gcode\")
file_path_2 = FilePath("C:\Users\james\AppData\Local\Programs\Python\Python311\python.exe")
# if you have more than one idraw (or grbl controller with drawcore installed) connected to your computer this component may work incorrectly
idraw_gh = IDraw_GH(Run=Button(), Commands=insert_items_4, GCodeFolder=file_path, PythonPath=file_path_2)
panel_2 = Panel(idraw_gh)
